test file "Example_AutoTest"

suite "Example_TestSuite"

  case "Example_TC_1_Scenario_1" [baseline]
    model Example, harness Example_AutoHarness
    input "input_scenario_1.mat" (active)
    iterations:
      Iteration1: ExternalInput "input_scenario_1.mat"

  case "Example_TC_2_Scenario_2" [baseline]
    model Example, harness Example_AutoHarness
    input "input_scenario_2.mat" (active)
    iterations:
      Iteration1: ExternalInput "input_scenario_2.mat"

  case "Example_TC_3_Scenario_3" [baseline]
    model Example, harness Example_AutoHarness
    input "input_scenario_3.mat" (active)
    iterations:
      Iteration1: ExternalInput "input_scenario_3.mat"

  case "Example_TC_4_Scenario_4" [baseline]
    model Example, harness Example_AutoHarness
    input "input_scenario_4.mat" (active)
    iterations:
      Iteration1: ExternalInput "input_scenario_4.mat"

  case "Example_TC_5_Scenario_5" [baseline]
    model Example, harness Example_AutoHarness
    input "input_scenario_5.mat" (active)
    iterations:
      Iteration1: ExternalInput "input_scenario_5.mat"