test file "SimulinkExample_AutoTest"

suite "SimulinkExample_TestSuite"

  case "SimulinkExample_TC_1_Scenario_1" [baseline]
    model SimulinkExample, harness SimulinkExample_AutoHarness
    input "input_scenario_1.mat" (active)
    iterations:
      Iteration1: ExternalInput "input_scenario_1.mat"

  case "SimulinkExample_TC_2_Scenario_2" [baseline]
    model SimulinkExample, harness SimulinkExample_AutoHarness
    input "input_scenario_2.mat" (active)
    iterations:
      Iteration1: ExternalInput "input_scenario_2.mat"

  case "SimulinkExample_TC_3_Scenario_3" [baseline]
    model SimulinkExample, harness SimulinkExample_AutoHarness
    input "input_scenario_3.mat" (active)
    iterations:
      Iteration1: ExternalInput "input_scenario_3.mat"

  case "SimulinkExample_TC_4_Scenario_4" [baseline]
    model SimulinkExample, harness SimulinkExample_AutoHarness
    input "input_scenario_4.mat" (active)
    iterations:
      Iteration1: ExternalInput "input_scenario_4.mat"

  case "SimulinkExample_TC_5_Scenario_5" [baseline]
    model SimulinkExample, harness SimulinkExample_AutoHarness
    input "input_scenario_5.mat" (active)
    iterations:
      Iteration1: ExternalInput "input_scenario_5.mat"