test file "NewModel_AutoTest"

suite "NewModel_TestSuite"

  case "NewModel_TC_1_Scenario_1" [baseline]
    model NewModel, harness NewModel_AutoHarness
    input "input_scenario_1.mat", mapped to alpha, beta (active)
    baseline "baseline_scenario_1.mat"
      gamma
      pi
    iterations:
      Iteration1: ExternalInput "input_scenario_1.mat"